# Dynamo custom node All Families Of Category.dyf (Dynamo 0.7.5.3566)
# category: Clockwork.Revit.Selection.ByCollector
# Gets all famiies of a given category in the model  (does *not *work for system families)

Categories = Input()
all_family_types_of_category = Custom[All Family Types Of Category](Categories=Categories)  # Gets all family types/symbols of a given category in the model (does *not *work for system families)
code_block = CodeBlock(ft=all_family_types_of_category) { List.UniqueItems(ft.Family); }
Families = Output(code_block)
