# Dynamo custom node Document.Path.dyf (Dynamo 0.7.4.3192)
# category: Clockwork.Revit.Document.Query
# Gets the path and directory of the current Revit document

python_script = Python()
# ---------- python_script.python (11 lines) ----------
import clr
clr.AddReference('RevitAPI')
from Autodesk.Revit.DB import *

clr.AddReference("RevitServices")
import RevitServices
from RevitServices.Persistence import DocumentManager

doc = DocumentManager.Instance.CurrentDBDocument

OUT = doc.PathName
# ----------------------------------------
path = Output(python_script)
fromPath = DirectoryObject(python_script)  # "Directory.FromPath"
directory = Output(fromPath)
