# Dynamo custom node Elements.GroupByHost.dyf "Group Elements By Host" (Dynamo 0.7.2.3911)
# category: CAAD_RWTH.Revit.Elements.Element.Actions
# Groups a list of Revit elements by their respective hosts (if they have any)

Element_s = Input()  # "Element(s)"
get_host = Custom[Get Host](element_s=Element_s)  # Gets an element's host
turn_into_list = Custom[Turn Into List](item=get_host)  # Turns an element (or a nested list) into a flat list
isNull = Object.IsNull()
map = List.Map(turn_into_list, isNull)
filterByBoolMask = List.FilterByBoolMask(turn_into_list, map)
turn_into_list_2 = Custom[Turn Into List](item=Element_s)
filterByBoolMask_2 = List.FilterByBoolMask(turn_into_list_2, map)
code_block = CodeBlock(filterByBoolMask.out1, filterByBoolMask_2.out1) { uniqueids = hosts.UniqueId; {uniqueids,elements}; 0; False; 1; }
sort_list_of_lists = Custom[Sort List Of Lists](List_of_lists=code_block.out1, Sort_index=code_block.out2, Case_insensitive=code_block.False, Order_Descending=code_block.False)  # Sorts a list of lists by one of its sublists
group_list_of_lists_by_key = Custom[Group List of Lists By Key](list=sort_list_of_lists, key_index=code_block.out2)  # Groups a list of lists by one of its keys
transpose = List.Transpose()
map_2 = List.Map(group_list_of_lists_by_key, transpose)
getItemAtIndex = List.GetItemAtIndex(arg1=code_block.out4)
map_3 = List.Map(map_2, getItemAtIndex)
Hosted = Output(map_3)
firstItem = List.FirstItem()
map_4 = List.Map(map_2, firstItem)
firstItem_2 = List.FirstItem()
map_5 = List.Map(map_4, firstItem_2)
ids_to_elements = Custom[IDs to Elements](ID_s_or_UniqueId_s=map_5)  # Gets the Revit element(s) for a list of IDs (or a single ID)
Host_s = Output(ids_to_elements.Element_s)  # "Host(s)"
Unhosted = Output(filterByBoolMask_2.out0)
