# Dynamo custom node List.AnyTrue.dyf (Dynamo 0.7.5.3566)
# category: Clockwork.Core.List.Query
# Returns true if any item in a list of booleans is true.

seq = Input()
turn_into_list = Custom[Turn Into List](item=seq)  # Turns an element (or a nested list) into a flat list
formula = Formula("x=1")
trueForAny = TrueForAny(turn_into_list, formula)
any = Output(trueForAny)  # "any?"
