# Dynamo custom node List.EqualSublistLengths.dyf (Dynamo 0.7.2.2114)
# category: Clockwork.Core.List.Actions
# Trims all given lists to the length of the shortest list

lists = Input()
getSublistLengths = Custom[Get Sublist Lengths](list=lists)  # "List.GetSublistLengths"; Gets the lengths of all sublists in a given list of lists.
minimumItem = List.MinimumItem(getSublistLengths)
takeItems = List.TakeItems(arg1=minimumItem)
map = List.Map(lists, takeItems)
lists_2 = Output(map)  # "lists"
