# Dynamo custom node List.NormalizedSequenceByFunction.dyf (Dynamo 0.7.2.2114)
# category: Clockwork.Core.List.Create
# Creates a sequence of N values between 0 and 1 driven by a function

N = Input()
code_block = CodeBlock(n=N) { 0..1..#n; }
f_x = Input()  # "f(x)"
map = List.Map(code_block, f_x)
Sequence = Output(map)
