# Dynamo custom node List.ReplaceItemAtIndex.dyf (Dynamo 0.7.5.3437)
# category: Clockwork.Core.List.Actions
# Replaces the item at a given index (or list of indices) of a list by another item

list = Input()
replacement = Input()
index_indices = Input()  # "index/indices"
turn_into_list = Custom[Turn Into List](item=index_indices)  # Turns an element (or a nested list) into a flat list
python_script = Python(IN[0]=list, IN[1]=replacement, IN[2]=turn_into_list)
# ---------- python_script.python (6 lines) ----------
thelist = IN[0]
thereplacement = IN[1]
indices = IN[2]
for index in indices:
	thelist[index] = thereplacement
OUT = thelist
# ----------------------------------------
list_2 = Output(python_script)  # "list"
