# Dynamo custom node List.SublistLengths.dyf (Dynamo 0.7.5.3566)
# category: Clockwork.Core.List.Query
# Gets the lengths of all sublists in a given list of lists.

list = Input()
count = List.Count()
map = List.Map(list, count)
lengths = Output(map)
