# Dynamo custom node Math.Normalize.dyf (Dynamo 0.7.5.3566)
# category: Clockwork.Core.Math.Actions
# Converts a value into a normalized value according to a value range

val = Input()
Min = Input()
Max = Input()
code_block = CodeBlock(value=val, min=Min, max=Max) { (value-min)/(max-min); }
