# Dynamo custom node Math.NormalizeRange.dyf (Dynamo 0.7.5.3566)
# category: Clockwork.Core.Math.Actions
# Normalizes a range of numbers

numbers = Input()
code_block = CodeBlock(nums=numbers) { Math.RemapRange(nums,0,1); }
Output = Output(code_block)  # ""
