# Dynamo custom node Math.RoundToPrecision.dyf (Dynamo 0.7.5.3566)
# category: Clockwork.Core.Math.Actions
# Rounds a number to a specified precision

Number = Input()
Precision = Input()
code_block = CodeBlock(a=Number, b=Precision) { Math.Round(a/b)*b; }
round = Output(code_block)
