# Dynamo custom node Math.RoundUpToPrecision.dyf (Dynamo 0.7.5.3566)
# category: Clockwork.Core.Math.Actions
# Rounds a number *up* to a specified precision

Number = Input()
Precision = Input()
code_block = CodeBlock(a=Number, b=Precision) { Math.Ceiling(a/b)*b; }
Ceiling = Output(code_block)
