# Dynamo custom node Math.ScaleNormalized.dyf (Dynamo 0.7.5.3566)
# category: Clockwork.Core.Math.Actions
# Scales a normalized value according to a given minimum and maximum

Min = Input()
Max = Input()
val = Input()
code_block = CodeBlock(min=Min, max=Max, value=val) { min+(max-min)*value; }
Output = Output(code_block)  # ""
