# Dynamo custom node Point.Average.dyf (Dynamo 0.7.4.3245)
# category: Clockwork.Geometry.Point.Query
# Determines the average of a list of points

Points = Input()
code_block = CodeBlock(p=Points) { Point.ByCoordinates(Math.Average(p.X),Math.Average(p.Y),Math.Average(p.Z)); }
Point = Output(code_block)
