# Dynamo custom node Point.CentralProjectionOnPlane.dyf (Dynamo 0.7.5.3566)
# category: Clockwork.Geometry.Point.Actions
# Projects a list of points onto a given plane

Central_projection_point = Input()
Point_s_to_be_projected = Input()  # "Point(s) to be projected"
code_block = CodeBlock(start=Central_projection_point, end=Point_s_to_be_projected) { Vector.ByTwoPoints(start,end).Normalized(); }
Plane = Input()
intersectionWithPlane = Custom[Vector.IntersectionWithPlane](Vector_Basepoint_s=Central_projection_point, Vector_s=code_block, Plane=Plane)  # Finds the intersection point between a plane and a vector
Projected_point_s = Output(intersectionWithPlane)  # "Projected point(s)"
