# Dynamo custom node PointSequence.ContainsOutOfPlanePoints.dyf (Dynamo 0.7.5.3566)
# category: Clockwork.Geometry.PointSequence.Query
# Checks a list for XYZs that are not located on a given plane

list = Input()
face_plane = Input()  # "face/plane"
isOutOfPlane = Custom[Point.IsOutOfPlane](Face_Plane=face_plane)  # Checks a list for XYZs that are not located on a given plane
map = List.Map(list, isOutOfPlane.bool)
anyTrue = Custom[True For Any (Boolean)](seq=map)  # "List.AnyTrue"; Returns true if any item in a list of booleans is true.
bool = Output(anyTrue)
map_2 = List.Map(list, isOutOfPlane.amount)
code_block = CodeBlock(seq=map_2) { List.MaximumItem(seq); }
max = Output(code_block)
