# Dynamo custom node PointSequences.ShortestPath.dyf (Dynamo 0.7.3.3034)
# category: Clockwork.Geometry.Point.Query
# Retrieves the shortest path from a number of point sequences

seq = Input()
accumulatedDistance = Custom[PointSequence.AccumulatedDistance]()  # Retrieves the accumulated distances of a sequence of points
map = List.Map(seq, accumulatedDistance)
minimumItem = List.MinimumItem(map)
distance = Output(minimumItem)
formula = Formula("x=y", minimumItem, map, lacing=Longest)
bool = Output(formula)
