# Dynamo custom node Room.Boundaries.dyf (Dynamo 0.7.2.26383)
# category: CAAD_RWTH.Revit.Elements.Room.Query
# Gets a list of all boundary elements of a given room

Room_s = Input()  # "Room(s)"
turn_into_list = Custom[Turn Into List](item=Room_s)  # Turns an element (or a nested list) into a flat list
python_script = Python(IN[0]=turn_into_list)
# ---------- python_script.python (35 lines) ----------
import clr
clr.AddReference('RevitAPI')
from Autodesk.Revit.DB import *
import Autodesk

clr.AddReference("RevitServices")
import RevitServices
from RevitServices.Persistence import DocumentManager

doc = DocumentManager.Instance.CurrentDBDocument
items = UnwrapElement(IN[0])
elementlist = list()

calculator = SpatialElementGeometryCalculator(doc)
options = Autodesk.Revit.DB.SpatialElementBoundaryOptions()
for item in items:
	#method #1 - get boundary segments
	blist = list()
	try:
		for boundarylist in item.GetBoundarySegments(options):
			for boundary in boundarylist:
				blist.append(boundary.Element)
	except:
		donothing = 1
	#method #2 - spatial element geometry calculator
	try:
		results = calculator.CalculateSpatialElementGeometry(item)
		for face in results.GetGeometry().Faces:
			for bface in results.GetBoundaryFaceInfo(face):
				blist.append(doc.GetElement(bface.SpatialBoundaryElement.HostElementId))
	except:
		donothing = 1	
	# write results to list
	elementlist.append(blist)
OUT = elementlist
# ----------------------------------------
uniqueItems = List.UniqueItems()
map = List.Map(python_script, uniqueItems)
return_list_or_single_value = Custom[Return List Or Single Value](list_1=turn_into_list, list_2=map)  # If the list in input #1 only contains one item, only the first item of the list in input #2 will be returned.
Elements = Output(return_list_or_single_value)
