# Dynamo custom node Room.DoorsOrWindows.dyf "Get Doors Or Windows From Room" (Dynamo 0.7.3.3034)
# category: Clockwork.Revit.Elements.Room.Query
# Retrieves all doors or windows that are associated with a room (hosted in walls and roofs).

Doors_Windows_Category = Input()  # "Doors/Windows (Category)"
all_elements_of_category = ElementsOfCategory(Doors_Windows_Category)
flatten = Flatten(all_elements_of_category)
Phase = Input()
fromDoorOrWindow = Custom[Room.FromDoorOrWindow](Door_s_Window_s=flatten, Phase=Phase)  # Gets the rooms that are connected by a given door or a window
isEmpty = List.IsEmpty()
map = List.Map(fromDoorOrWindow.From_Room_s, isEmpty)
isNull = Object.IsNull(map)
filterByBoolMask = List.FilterByBoolMask(flatten, isNull)
fromDoorOrWindow_2 = Custom[Room.FromDoorOrWindow](Door_s_Window_s=filterByBoolMask, Phase=Phase)
uniqueId = Element.UniqueId(fromDoorOrWindow_2.From_Room_s)
Room = Input()
uniqueId_2 = Element.UniqueId(Room)
eq = uniqueId_2 == _
map_2 = List.Map(uniqueId, eq)
filterByBoolMask_2 = List.FilterByBoolMask(filterByBoolMask, map_2)
map_3 = List.Map(fromDoorOrWindow.To_Room_s, isEmpty)
isNull_2 = Object.IsNull(map_3)
filterByBoolMask_3 = List.FilterByBoolMask(flatten, isNull_2)
fromDoorOrWindow_3 = Custom[Room.FromDoorOrWindow](Door_s_Window_s=filterByBoolMask_3, Phase=Phase)
uniqueId_3 = Element.UniqueId(fromDoorOrWindow_3.To_Room_s)
map_4 = List.Map(uniqueId_3, eq)
filterByBoolMask_4 = List.FilterByBoolMask(filterByBoolMask_3, map_4)
create_list = List.Create(filterByBoolMask_2, filterByBoolMask_4)
flatten_2 = Flatten(create_list)
Doors_Windows = Output(flatten_2)  # "Doors/Windows"
