# Dynamo custom node Surface.FilterByOrientation.dyf (Dynamo 0.7.5.3566)
# category: Clockwork.Geometry.Surface.Actions
# Sorts surfaces in three lists based on their orientation (vertical, horizontal up & horizontal down) and also returns three corresponding lists of booleans.

Face_s = Input()  # "Face(s)"
code_block = CodeBlock { 0.5; }
normalAtParameter = Surface.NormalAtParameter(Face_s, code_block, code_block)
Z = Vector.Z(normalAtParameter)
almostZero = Custom[Math.AlmostZero]()  # Returns a feasable computational tolerance to zero (1.0e-9 or a billionth of 1) for use in calculations. More background info: https://github.com/ikeough/Dynamo/issues/879
formula = Formula("z > (0-almostzero) && z < (0+almostzero)", z=Z, almostzero=almostZero)
filterByBoolMask = List.FilterByBoolMask(Face_s, formula)
Vertical = Output(filterByBoolMask)
YAxis = Vector.YAxis()
isAlmostEqualTo = Vector.IsAlmostEqualTo(normalAtParameter, YAxis)
filterByBoolMask_2 = List.FilterByBoolMask(Face_s, isAlmostEqualTo)
Horizontal_Up = Output(filterByBoolMask_2)
YAxisNegative = Custom[Vector.YAxisNegative]()  # Returns an XYZ of 0,-1,0
isAlmostEqualTo_2 = Vector.IsAlmostEqualTo(normalAtParameter, YAxisNegative)
filterByBoolMask_3 = List.FilterByBoolMask(Face_s, isAlmostEqualTo_2)
Horizontal_Down = Output(filterByBoolMask_3)
IsVertical = Output(formula)
IsHorizontalUp = Output(isAlmostEqualTo)
IsHorizontalDown = Output(isAlmostEqualTo_2)
