# Dynamo custom node Vector.AltitudeAndAzimuth.dyf (Dynamo 0.7.5.3437)
# category: Clockwork.Geometry.Vector.Query
# Computes the altitude and azimuth of a given vector

vector_zaxis_negative = Custom[Z Axis (Negative)]()  # Returns an XYZ of 0,0,-1
Vector = Input()
code_block = CodeBlock(sundir=Vector)
# ---------- code_block.designscript (6 lines) ----------
// Turn normalized vector into point
vec = sundir.Normalized().AsPoint();
Point.Origin();
Vector.YAxis().AsPoint();
// Project point to XY plane
Point.ByCoordinates(vec.X,vec.Y);
# ----------------------------------------
solveByPoints = Custom[Solve Triangle By XYZs](XYZ_A=code_block.vec, XYZ_B=code_block.out1, XYZ_C=code_block.out3)  # "Triangle.SolveByPoints"; Solves a triangle based on the XYZ coordinates of its vertices.
solveByPoints_2 = Custom[Solve Triangle By XYZs](XYZ_A=code_block.out3, XYZ_B=code_block.out1, XYZ_C=code_block.out2)  # "Triangle.SolveByPoints"
code_block_2 = CodeBlock(zan=vector_zaxis_negative, vec=code_block.vec, x=solveByPoints.beta, a=solveByPoints_2.beta)
# ---------- code_block_2.designscript (6 lines) ----------
cond1 = zan.AsPoint().IsAlmostEqualTo(vec);
zdir = vec.Z < 0 ? -x : x;
res1 = cond1 ? -90 : zdir;
cond2 = Vector.ZAxis().AsPoint().IsAlmostEqualTo(vec);
cond2 ? 90 : res1;
vec.X < 0 ? 360-a : a;
# ----------------------------------------
Altitude = Output(code_block_2.out4)
Azimuth = Output(code_block_2.out5)
