# Dynamo custom node Vector.IsInPlane.dyf (Dynamo 0.7.5.3566)
# category: Clockwork.Geometry.Vector.Query
# Checks if a given vector is located on a given plane

Vector = Input()
code_block = CodeBlock(vec=Vector) { vec.Normalized(); }
Plane = Input()
isParallelToPlane = Custom[Vector.IsParallelToPlane](Vector=code_block, Plane=Plane)  # Checks if a given vector is parallel to a given plane
Vector_Basepoint = Input()
isOutOfPlane = Custom[Point.IsOutOfPlane](Face_Plane=Plane, Point=Vector_Basepoint)  # Checks a list for XYZs that are not located on a given plane
code_block_2 = CodeBlock(a=isParallelToPlane, b=isOutOfPlane.bool) { AllTrue({a,!b}); }
bool = Output(code_block_2)
