# Dynamo custom node Vector.PruneDuplicates.dyf (Dynamo 0.7.4.3245)
# category: Clockwork.Geometry.Vector.Actions
# Prune vectors to exclude duplicates within a given tolerance

Vectors = Input()
Tolerance = Input()
code_block = CodeBlock(v=Vectors, tol=Tolerance) { v.AsPoint().PruneDuplicates(tol).AsVector(); }
Vectors_2 = Output(code_block)  # "Vectors"
