# Dynamo custom node XYZAxis.FromVector.dyf (Dynamo 0.7.2.3911)
# category: Clockwork.Geometry.Vector.Create
# Returns whichever main axis (X, Y or Z) is closest to a given vector

Vector = Input()
code_block = CodeBlock(vec=Vector)
# ---------- code_block.designscript (3 lines) ----------
cond1 = Math.Abs(vec.Y) > Math.Abs(vec.X) && Math.Abs(vec.Y) > Math.Abs(vec.Z);
cond2 = Math.Abs(vec.X) > Math.Abs(vec.Y) && Math.Abs(vec.X) > Math.Abs(vec.Z);
cond2 ? Vector.XAxis() : (cond1 ? Vector.YAxis() : Vector.ZAxis());
# ----------------------------------------
XYZ_Axis = Output(code_block.out2)
