# Dynamo custom node All Placed Family Types of Category.dyf (Dynamo 1.3.1.1736)
# category: Clockwork.Revit.Selection.ByCollector
# Retrieves all family types of a given category that have *placed* instances

category = Input(category : Category)
all_elements_of_category = ElementsOfCategory(category)
elementType = Element.ElementType(all_elements_of_category)
uniqueItems = List.UniqueItems(elementType)
familyTypes = Output(uniqueItems)
