# Dynamo custom node Document.BuiltInCategories.dyf (Dynamo 0.9.0.3067)
# category: Clockwork.Revit.Document.Query
# List all the available BuiltInCategories

python_script = Python()
# ---------- python_script.python (15 lines) ----------
import clr
import System
clr.AddReference('RevitAPI')
clr.AddReference('RevitAPIUI')
from Autodesk.Revit.DB import *
import Autodesk

bics = System.Enum.GetValues(BuiltInCategory)
cdata = list()
for bic in bics:
	try:
		cdata.append((bic,ElementId(bic)))
	except:
		pass
OUT = cdata
# ----------------------------------------
transpose = List.Transpose(python_script)
code_block = CodeBlock(seq=transpose) { seq[0]; seq[1]; }
BuiltInCategories = Output(code_block.out0)
ElementIDs = Output(code_block.out1)
