# Dynamo custom node Document.ProjectParametersByCategory.dyf (Dynamo 1.0.0.1180)
# category: Clockwork.Revit.Document.Query
# Retrieves all project parameters for a given category

category = Input()
turnIntoList = Custom[TurnIntoList](unknownItem=category)  # Turns an element (or a nested list) into a flat list
toggle = Input(toggle : bool = true)
python_script = Python(IN[0]=turnIntoList, IN[1]=toggle)
# ---------- python_script.python (25 lines) ----------
import clr
clr.AddReference('RevitAPI')
from Autodesk.Revit.DB import *
import Autodesk

clr.AddReference("RevitServices")
import RevitServices
from RevitServices.Persistence import DocumentManager

search_cats = UnwrapElement(IN[0])
search_ids = []
cats = []
for search_cat in search_cats:
	search_ids.append(search_cat.Id.IntegerValue)
	cats.append(list())
doc = DocumentManager.Instance.CurrentDBDocument
iterator = doc.ParameterBindings.ForwardIterator()
while iterator.MoveNext():
	for cat in iterator.Current.Categories:
		i = 0
		for search_id in search_ids:
			if cat.Id.IntegerValue == search_id:
				cats[i].append(iterator.Key.Name)
			i += 1
OUT = cats
# ----------------------------------------
returnListOrSingleValue = Custom[ReturnListOrSingleValue](unknownItem=category, seq=python_script)  # If the unknown item is not a list but rather a single item, only the first item of the list (input "seq") will be returned.
paramName = Output(returnListOrSingleValue)
