# Dynamo custom node Door.Rooms.dyf (Dynamo 0.8.2.2392)
# category: Clockwork.Revit.Elements.Door.Query
# Gets the rooms that are connected by a given door

door = Input(door : FamilyInstance)
turn_into_list = Custom[Turn Into List](door)  # Turns an element (or a nested list) into a flat list
phase = Input()
python_script = Python(IN[0]=turn_into_list, IN[1]=phase)
# ---------- python_script.python (28 lines) ----------
import clr
clr.AddReference('RevitAPI')
from Autodesk.Revit.DB import *

items = UnwrapElement(IN[0])
phase = UnwrapElement(IN[1])
fromlist = list()
tolist = list()
numexits = list()

for item in items:
	exits = 0
	try:	
		if item.FromRoom[phase]:
			fromlist.append(item.FromRoom[phase])
			exits += 1
		else:
			fromlist.append(list())
		if item.ToRoom[phase]:
			tolist.append(item.ToRoom[phase])
			exits += 1
		else:
			tolist.append(list())
	except:
		fromlist.append(list())
		tolist.append(list())
	numexits.append(exits)
OUT = (fromlist,tolist,numexits)
# ----------------------------------------
code_block = CodeBlock(seq=python_script) { seq[0]; seq[1]; seq[2]; }
returnListOrSingleValue = Custom[ReturnListOrSingleValue](unknownItem=door, seq=code_block.out0)  # If the item in input #1 is not a list, only the first item of the list in input #2 will be returned.
fromRoom = Output(returnListOrSingleValue)
returnListOrSingleValue_2 = Custom[ReturnListOrSingleValue](unknownItem=door, seq=code_block.out1)
toRoom = Output(returnListOrSingleValue_2)
returnListOrSingleValue_3 = Custom[ReturnListOrSingleValue](unknownItem=door, seq=code_block.out2)
roomCount = Output(returnListOrSingleValue_3)
