# Dynamo custom node Element.Category+.dyf (Dynamo 1.3.2.2480)
# category: Clockwork.Revit.Elements.Element.Query
# Returns the category of a given element. Unlike the OOTB node Element.GetCategory, it will work for families, schedules, subcategories and graphics styles as well.

element = Input()
python_script = Python(IN[0]=element)
# ---------- python_script.python (25 lines) ----------
import clr
clr.AddReference('RevitAPI')
from Autodesk.Revit.DB import *

clr.AddReference("RevitNodes")
import Revit
clr.ImportExtensions(Revit.Elements)

def GetCategory(item):
	objtype = item.GetType().ToString()
	if objtype == "Autodesk.Revit.DB.ViewSchedule": return Revit.Elements.Category.ById(item.Definition.CategoryId.IntegerValue)
	elif objtype == "Autodesk.Revit.DB.Family": return Revit.Elements.Category.ById(item.FamilyCategoryId.IntegerValue)
	elif objtype == "Autodesk.Revit.DB.GraphicsStyle": return Revit.Elements.Category.ById(item.GraphicsStyleCategory.Id.IntegerValue)
	elif objtype == "Autodesk.Revit.DB.Category": 
		if item.Parent: return Revit.Elements.Category.ById(item.Parent.Id.IntegerValue)
		else: return None
	elif hasattr(item, "Category"): 
		try: return Revit.Elements.Category.ById(item.Category.Id.IntegerValue)
		except: return None
	else: return None

items = UnwrapElement(IN[0])

if isinstance(IN[0], list): OUT = [GetCategory(x) for x in items]
else: OUT = GetCategory(items)
# ----------------------------------------
category = Output(python_script)
