# Dynamo custom node Roof.SlabShapeByPoints.dyf (Dynamo 1.3.0.875)
# category: Clockwork.Revit.Elements.Roof.Actions
# Transform a slab shape based on a list of XYZs. PLEASE NOTE: Will reset any previous edits on the slab shape.

points = Input(points : Autodesk.Point[])
turnIntoList = Custom[Turn Into List](unknownItem=points)  # Turns an element (or a nested list) into a flat list
roof = Input()
python_script = Python(IN[0]=turnIntoList, IN[1]=roof)
# ---------- python_script.python (25 lines) ----------
import clr
clr.AddReference('RevitAPI')
from Autodesk.Revit.DB import *

clr.AddReference("RevitNodes")
import Revit
clr.ImportExtensions(Revit.GeometryConversion)

clr.AddReference("RevitServices")
import RevitServices
from RevitServices.Persistence import DocumentManager
from RevitServices.Transactions import TransactionManager

doc = DocumentManager.Instance.CurrentDBDocument
xyzs = IN[0]
slabshape = UnwrapElement(IN[1])
successlist = list()
faillist = list()

TransactionManager.Instance.EnsureInTransaction(doc)
for item in xyzs:
	slabshape.SlabShapeEditor.DrawPoint(item.ToXyz())
TransactionManager.Instance.TransactionTaskDone()

OUT = slabshape
# ----------------------------------------
roof_2 = Output(python_script)  # "roof"
