# Dynamo custom node Room.UnplacedByNameAndNumber.dyf (Dynamo 1.0.0.1180)
# category: Clockwork.Revit.Elements.Room.Create
# Creates an unplaced room

name = Input(name : string)
turnIntoList = Custom[Turn Into List](unknownItem=name)  # Turns an element (or a nested list) into a flat list
number = Input(number : string)
turnIntoList_2 = Custom[Turn Into List](unknownItem=number)
phase = Input()
python_script = Python(IN[0]=turnIntoList, IN[1]=turnIntoList_2, IN[2]=phase)
# ---------- python_script.python (27 lines) ----------
import clr
clr.AddReference('RevitAPI')
from Autodesk.Revit.DB import *

clr.AddReference("RevitServices")
import RevitServices
from RevitServices.Persistence import DocumentManager
from RevitServices.Transactions import TransactionManager

doc = DocumentManager.Instance.CurrentDBDocument
doccreation = doc.Create
names = IN[0]
numbers = IN[1]
phase = UnwrapElement(IN[2])
counter = 0
elementlist = list()

TransactionManager.Instance.EnsureInTransaction(doc)
for name in names:
	newroom = doccreation.NewRoom(phase)
	newroom.Name = name
	newroom.Number = numbers[counter]
	elementlist.append(newroom)
	counter += 1
TransactionManager.Instance.TransactionTaskDone()

OUT = elementlist
# ----------------------------------------
returnListOrSingleValue = Custom[ReturnListOrSingleValue](unknownItem=name, seq=python_script)  # If the item in input #1 is not a list, only the first item of the list in input #2 will be returned.
room = Output(returnListOrSingleValue)
