# Dynamo custom node Switch.dyf (Dynamo 1.3.2.2480)
# category: Clockwork.Core.Logic.Actions
# Emulates the Switch/Case statement that is  available in multiple programming languages.

Check = Input()
turnIntoList = Custom[TurnIntoList](unknownItem=Check)  # Turns an element (or a nested list) into a flat list
Cases = Input()
Values = Input()
matchWithKeyValues = Custom[List.MatchWithKeyValues](seq=turnIntoList, keys=Cases, values=Values)  # Matches a list with a given set of keys and returns the values corresponding to the keys
Default = Input()
replaceNull = Custom[List.ReplaceNull](seq=matchWithKeyValues, replacement=Default)  # Replaces all null values within a given list with a substitute
Result = Output(replaceNull)
