# Dynamo custom node Time.LapTime.dyf (Dynamo 1.3.1.1736)
# category: Clockwork.Core.Time.Query
# Records a timestamp and adds it to a given list of lap times. Also passes through an arbitrary variable for integration into a graph.

LapTimes = Input(LapTimes : double[] = List.Empty)
rerunToggle = Input(rerunToggle : bool = false)
python_script = Python(IN[0]=LapTimes, IN[1]=rerunToggle)
# ---------- python_script.python (7 lines) ----------
import time

times = IN[0]

times.append(time.time())

OUT = times
# ----------------------------------------
LapTimes_2 = Output(python_script)  # "LapTimes"
Passthrough = Input()
Passthrough_2 = Output(Passthrough)  # "Passthrough"
