# Dynamo custom node All Families Of Category.dyf (Dynamo 2.12.1.8246)
# category: Clockwork.Revit.Selection.Collectors.Query
# Gets all famiies of a given category in the model  (does *not *work for system families)
# packages: Clockwork for Dynamo 2.x 2.6.0

docOrRevitLinkInstance = Input(docOrRevitLinkInstance: var = null)  # Use only if you want to query a linked model
toggle = Input(toggle: bool = true)
category = Input(category: var[]..[])  # Works with categories, BuiltInCategories and BuiltInCategories as strings
fromInput = Custom[Category.FromInput](category=category)  # package Clockwork for Dynamo 2.x; Returns a category from a category, a Dynamo-wrapped category, a BuiltInCategory or a string representing a BuiltInCategory.
python_script = Python(IN[0]=docOrRevitLinkInstance, IN[1]=toggle, IN[2]=fromInput)  # IronPython2
# ---------- python_script.python (25 lines) ----------
import System
import clr
clr.AddReference('RevitAPI')
from Autodesk.Revit.DB import *

clr.AddReference("RevitServices")
import RevitServices
from RevitServices.Persistence import DocumentManager

inputdoc = UnwrapElement(IN[0])
if not inputdoc: doc = DocumentManager.Instance.CurrentDBDocument
elif inputdoc.GetType().ToString() == "Autodesk.Revit.DB.RevitLinkInstance": doc = inputdoc.GetLinkDocument()
elif inputdoc.GetType().ToString() == "Autodesk.Revit.DB.Document": doc = inputdoc
else: doc = DocumentManager.Instance.CurrentDBDocument
cats = IN[2]

collector = FilteredElementCollector(doc).OfClass(Family)
items = collector.ToElements()

def ReturnIfCategory(items, cat):
	return [x for x in items if x.FamilyCategory.Id.IntegerValue == cat.Id.IntegerValue]
	#return [(x.FamilyCategory.Id, cat.Id) for x in items]

if isinstance(cats, list): OUT = [ReturnIfCategory(items, x) for x in cats]
else: OUT = ReturnIfCategory(items, cats)
# ----------------------------------------
families = Output(python_script)
