# Dynamo custom node All Intersecting Elements Of Category By BoundingBox.dyf "All Intersecting Elements of Category By BoundingBox" (Dynamo 2.0.0.4654)
# category: Clockwork.Revit.Selection.Collectors.Query
# Finds all elements that intersect the bounding box of a given element

element = Input(element: var[]..[])
turnIntoList = Custom[TurnIntoList](unknownItem=element)  # Turns an element (or a nested list) into a flat list
threeDview = Input(threeDview: Revit.Elements.Views.View3D = null)
isNull = Object.IsNull(obj=threeDview)
activeViewFromCurrentDocument = Custom[Document.ActiveViewFromCurrentDocument]()  # Gets the active view of the current document
if_ = If(test=isNull, true=activeViewFromCurrentDocument, false=threeDview)
tolerance = Input(tolerance: double = 0)
unit_types = UnitTypes(index=2)  # graph input
toInternalUnit = Custom[DisplayUnit.ToInternalUnit](val=tolerance, displayUnitType=unit_types)  # Converts a value from a given display unit to Revit's internal unit
categories = Input(categories: var[]..[])
turnIntoList_2 = Custom[TurnIntoList](unknownItem=categories)
python_script = Python(IN[0]=turnIntoList, IN[1]=if_, IN[2]=toInternalUnit, IN[3]=turnIntoList_2)
# ---------- python_script.python (43 lines) ----------
import clr

import System
from System.Collections.Generic import *

clr.AddReference('RevitAPI')
from Autodesk.Revit.DB import *

clr.AddReference("RevitNodes")
import Revit
clr.ImportExtensions(Revit.Elements)
clr.ImportExtensions(Revit.GeometryConversion)

clr.AddReference("RevitServices")
import RevitServices
from RevitServices.Persistence import DocumentManager

doc = DocumentManager.Instance.CurrentDBDocument
cutters = UnwrapElement(IN[0])
view = UnwrapElement(IN[1])
tol = IN[2]
cats = UnwrapElement(IN[3])

catlist = []
for cat in cats:
	catlist.append(cat.Id)
filtercats = List[ElementId](catlist)
catfilter = ElementMulticategoryFilter(filtercats)

intersectorlist = list()
for cutter in cutters:
	if cutter is None: intersectorlist.append([])
	else:
		bbox = cutter.get_BoundingBox(view)
		bboxfilter = BoundingBoxIntersectsFilter(Outline(bbox.Min,bbox.Max),tol)
		collector = FilteredElementCollector(doc, view.Id)
		excludelist = []
		excludelist.append(cutter.Id)
		excludeIDs = List[ElementId](excludelist)
		excfilter = ExclusionFilter(excludeIDs)
		intersectorlist.append(collector.WherePasses(bboxfilter).WherePasses(excfilter).WherePasses(catfilter).ToElements())
	
OUT = intersectorlist
# ----------------------------------------
intersectingElements = Output(python_script)
