# Dynamo custom node All Placed Family Types of Category.dyf (Dynamo 1.3.1.1736)
# category: Clockwork.Revit.Selection.Collectors.Query
# Retrieves all family types of a given category that have *placed* instances

category = Input(category : Category)
all_elements_of_category = ElementsOfCategory(category)
elementType = Custom[Element.ElementType+](element=all_elements_of_category)  # Gets the family type of a given element (if applicable). Unlike the OOTB node, it also works for elements in linked models.
uniqueItems = List.UniqueItems(elementType)
familyTypes = Output(uniqueItems)
