# Dynamo custom node Document.ActiveViewFromCurrentDocument.dyf (Dynamo 1.3.0.875)
# category: Clockwork.Revit.Application.Query
# Gets the active view of the current document

current = Document.Current()
activeView = Document.ActiveView(current)
View = Output(activeView)
