# Dynamo custom node Document.DesignOptions.dyf (Dynamo 2.0.4.12684)
# category: Clockwork.Revit.Application.Query
# Returns all design options in the model, grouped by design option set

string = StringInput("DesignOption")
byName = Custom[ElementType.ByName](name=string)  # Retrieves an element type by its name - to be used with the OOTB node "All Elements of Type".
all_elements_of_type = ElementsOfType(element_type=byName)
designOptionSet = Custom[DesignOption.DesignOptionSet](designOption=all_elements_of_type)  # Returns the design option set of a given design option
groupByKey = List.GroupByKey(list=all_elements_of_type, keys=designOptionSet)
DesignOptions = Output(groupByKey.groups)
DesignOptionSets = Output(groupByKey.unique_keys)
