# Dynamo custom node Element.ElementType+.dyf (Dynamo 2.12.1.8246)
# category: Clockwork.Revit.Elements.Query
# Gets the family type of a given element (if applicable). Unlike the OOTB node, it also works for elements in linked models.

element = Input(element: var[]..[])
python_script = Python(IN[0]=element)  # IronPython2
# ---------- python_script.python (8 lines) ----------
def GetElementType(element):
	try: return element.Document.GetElement(element.GetTypeId())
	except: return None

items = UnwrapElement(IN[0])

if isinstance(IN[0], list): OUT = [GetElementType(x) for x in items]
else: OUT = GetElementType(items)
# ----------------------------------------
type = Output(python_script)
