# Dynamo custom node Element.IsOfCategory.dyf (Dynamo 1.3.1.1736)
# category: Clockwork.Revit.Elements.Element.Query
# Checks whether an element is of a specified category

category = Input()
id = Category.Id(category)
element = Input()
category_2 = Custom[Element.Category+](element=element)  # Returns the category of a given element. Unlike the OOTB node Element.GetCategory, it will work for families, schedules and graphics styles as well.
id_2 = Category.Id(category_2)
containsItem = List.ContainsItem(list=id, item=id_2)
bool = Output(containsItem)
