# Dynamo custom node Element.MoveToPoint.dyf (Dynamo 2.0.4.12684)
# category: Clockwork.Revit.Elements.Actions
# Moves a point-based element to the given location

element = Input(element: var[]..[])
getLocation = Element.GetLocation(element=element)
point = Input(point: Autodesk.DesignScript.Geometry.Point[]..[])
byTwoPoints = Vector.ByTwoPoints(start=getLocation, end=point)
moveByVector = Element.MoveByVector(element=element, vector=byTwoPoints)
passthrough = Custom[Passthrough](passThrough=element, waitFor=moveByVector)  # Forces a sequential order of execution. The node wired into the output of the Passthrough node will be executed *after* the node wired into the waitFor input (e.g. important for some Revit operations). The value of the passThrough input will be passed on to the node wired into the output port of the Passthrough node.
element_2 = Output(passthrough)  # "element"
getLocation_2 = Element.GetLocation(element=passthrough)
isAlmostEqualTo = Geometry.IsAlmostEqualTo(geometry=getLocation_2, other=point)
success = Output(isAlmostEqualTo)
