# Dynamo custom node Element.SetName.dyf (Dynamo 1.3.1.1736)
# category: Clockwork.Revit.Elements.Element.Actions
# Gets the name of a given Revit element

name = Input()
element = Input()
turnIntoList = Custom[Turn Into List](unknownItem=element)  # Turns an element (or a nested list) into a flat list
turnIntoList_2 = Custom[Turn Into List](unknownItem=name)
code_block = CodeBlock(seq1=turnIntoList, seq2=turnIntoList_2)
# ---------- code_block.designscript (4 lines) ----------
num = List.Count(seq1);
cond = List.Count(seq2) < 2 && num > 1;
repseq = List.OfRepeatedItem(seq2[0],num);
cond ? repseq : seq2;
# ----------------------------------------
python_script = Python(IN[0]=turnIntoList, IN[1]=code_block.out3)
# ---------- python_script.python (30 lines) ----------
import clr
clr.AddReference('RevitAPI')
from Autodesk.Revit.DB import *

clr.AddReference("RevitNodes")
import Revit
clr.ImportExtensions(Revit.Elements)

clr.AddReference("RevitServices")
import RevitServices
from RevitServices.Persistence import DocumentManager
from RevitServices.Transactions import TransactionManager

doc = DocumentManager.Instance.CurrentDBDocument
items = UnwrapElement(IN[0])
names = IN[1]
booleans = []
counter = 0

TransactionManager.Instance.EnsureInTransaction(doc)
while counter < len(items):
	try:
		items[counter].Name = names[counter]
		booleans.append(True)
	except:
		booleans.append(False)
	counter += 1
TransactionManager.Instance.TransactionTaskDone()

OUT = (items, booleans)
# ----------------------------------------
code_block_2 = CodeBlock(seq=python_script) { seq[0]; seq[1]; }
returnListOrSingleValue = Custom[ReturnListOrSingleValue](unknownItem=name, seq=code_block_2.out0)  # If the unknown item is not a list but rather a single item, only the first item of the list (input "seq") will be returned.
element_2 = Output(returnListOrSingleValue)  # "element"
returnListOrSingleValue_2 = Custom[ReturnListOrSingleValue](unknownItem=name, seq=code_block_2.out1)
success = Output(returnListOrSingleValue_2)
