# Dynamo custom node Element.SuperComponent.dyf (Dynamo 2.12.1.8246)
# category: Clockwork.Revit.Elements.Query
# Retrieves the supercomponent of a given family instance, hand rail, top rail, stair component, topography subregion or beam in a beam system.

element = Input(element: var[]..[])
python_script = Python(IN[0]=element)  # IronPython2
# ---------- python_script.python (21 lines) ----------
import clr
clr.AddReference('RevitAPI')
from Autodesk.Revit.DB import *

def GetSuperComponent(item):
	if hasattr(item, "SuperComponent"): 
		sc = item.SuperComponent
		if sc: return sc
		else: return BeamSystem.BeamBelongsTo(item)
	if hasattr(item, "HostRailingId"): return item.Document.GetElement(item.HostRailingId)
	elif hasattr(item, "GetStairs"): return item.GetStairs()
	elif hasattr(item, "IsSiteSubRegion"):
		if item.IsSiteSubRegion:
			return item.Document.GetElement(item.AsSiteSubRegion().HostId)
		else: return None
	else: return None

items = UnwrapElement(IN[0])

if isinstance(IN[0], list): OUT = [GetSuperComponent(x) for x in items]
else: OUT = GetSuperComponent(items)
# ----------------------------------------
superComponent = Output(python_script)
