# Dynamo custom node Group.Members.dyf (Dynamo 2.6.1.8786)
# category: Clockwork.Revit.Elements.Query
# Retrieves the members of a group. ATTENTION: This node will be deprecated in 2023. Please switch to the OOTB node Group.GetMembers.

group = Input(group: var[]..[])
python_script = Python(IN[0]=group)
# ---------- python_script.python (12 lines) ----------
import clr
clr.AddReference('RevitAPI')
from Autodesk.Revit.DB import *

def GetMembers(item):
	if hasattr(item, "GetMemberIds"): return [item.Document.GetElement(x) for x in item.GetMemberIds()]
	else: return list()

items = UnwrapElement(IN[0])

if isinstance(IN[0], list): OUT = [GetMembers(x) for x in items]
else: OUT = GetMembers(items)
# ----------------------------------------
memberElements = Output(python_script)
