# Dynamo custom node RevitFaceReference.FromDynamoSurface.dyf (Dynamo 0.8.2.2392)
# category: Clockwork.Revit.Selection.ByFace.Query
# Returns the underlying Revit face reference of a given surface

DynamoSurface = Input(DynamoSurface : Surface)
turnIntoList = Custom[Turn Into List](DynamoSurface)  # Turns an element (or a nested list) into a flat list
python_script = Python(IN[0]=turnIntoList)
# ---------- python_script.python (13 lines) ----------
import clr
clr.AddReference('RevitAPI')
from Autodesk.Revit.DB import *

faces = UnwrapElement(IN[0])
elementlist = list()
for face in faces:
	try:
		ref = face.Tags.LookupTag("RevitFaceReference")
		elementlist.append(ref)
	except:
		elementlist.append(list())
OUT = elementlist
# ----------------------------------------
returnListOrSingleValue = Custom[ReturnListOrSingleValue](unknownItem=DynamoSurface, seq=python_script)  # If the item in input #1 is not a list, only the first item of the list in input #2 will be returned.
RevitFaceReference = Output(returnListOrSingleValue)
