# Dynamo custom node Switch.dyf (Dynamo 2.0.1.5055)
# category: Clockwork.Script.ControlFlow.Actions
# Emulates the Switch/Case statement that is  available in multiple programming languages.

Check = Input(Check: var[]..[])
turnIntoList = Custom[TurnIntoList](unknownItem=Check)  # Turns an element (or a nested list) into a flat list
Cases = Input(Cases: var[]..[])
Values = Input(Values: var[]..[])
matchWithKeyValues = Custom[List.MatchWithKeyValues](seq=turnIntoList, keys=Cases, values=Values)  # Matches a list with a given set of keys and returns the values corresponding to the keys
Default = Input(Default: var[]..[])
replaceNull = Custom[List.ReplaceNull](seq=matchWithKeyValues, replacement=Default)  # Replaces all null values within a given list with a substitute
Result = Output(replaceNull)
