# Dynamo custom node RevitLinkType.Unload.dyf (Dynamo 2.12.1.8246)
# category: Clockwork.Revit.Elements.Actions
# Unloads a Revit or IFC link

revitLinkType = Input(revitLinkType: var[]..[])
revitLinkType_2 = Output(revitLinkType)  # "revitLinkType"
forCurrentUserOnly = Input(forCurrentUserOnly: bool = false)  # Only works on workshared models
python_script = Python(IN[0]=revitLinkType, IN[1]=forCurrentUserOnly)  # CPython3
# ---------- python_script.python (27 lines) ----------
import clr
clr.AddReference('RevitAPI')
from Autodesk.Revit.DB import *

clr.AddReference("RevitNodes")
import Revit
clr.ImportExtensions(Revit.Elements)

clr.AddReference("RevitServices")
import RevitServices
from RevitServices.Persistence import DocumentManager
from RevitServices.Transactions import TransactionManager

doc = DocumentManager.Instance.CurrentDBDocument
linktypes = UnwrapElement(IN[0])
unload_locally = IN[1]

def UnloadLinkType(linktype):
	try:
		if unload_locally and doc.IsWorkshared: linktype.UnloadLocally(None)
		else: linktype.Unload(None)
		return True
	except: return False

TransactionManager.Instance.ForceCloseTransaction()
if isinstance(IN[0], list): OUT = [UnloadLinkType(x) for x in linktypes]
else: OUT = UnloadLinkType(linktypes)
# ----------------------------------------
success = Output(python_script)
