# Dynamo graph Core.Logic.dyn (Dynamo 0.7.5.3566)

code_block = CodeBlock { 2..6; }
watch = Watch(code_block)
code_block_2 = CodeBlock { 1..4; }
watch_2 = Watch(code_block_2)
string = StringInput("""A
B
C
D""")
string_2 = StringInput("\n")
split = String.Split(string, string_2)
watch_3 = Watch(split)
string_3 = StringInput("E")
switch = Custom[Switch](cases=watch_2, values=watch_3, default=string_3)  # Emulates the Switch/Case statement that is available in multiple programming languages.
map = List.Map(watch, switch)
watch_4 = Watch(map)
code_block_3 = CodeBlock { 1; 4; }
watch_5 = Watch(code_block_3.out0)
create = List.Create(code_block_3.out1)
watch_6 = Watch(create)
returnListOrSingleValue = Custom[ReturnListOrSingleValue](item_1_unknown=watch_5, item_2_list=watch_6)  # If the item in input #1 is not a list, only the first item of the list in input #2 will be returned.
watch_7 = Watch(returnListOrSingleValue)
create_2 = List.Create(code_block_3.out0)
watch_8 = Watch(create_2)
returnListOrSingleValue_2 = Custom[ReturnListOrSingleValue](item_1_unknown=watch_8, item_2_list=watch_6)
watch_9 = Watch(returnListOrSingleValue_2)
