# Dynamo graph Revit.Elements.Floor.dyn (Dynamo 1.0.0.1180)

categories = Categories("Floors")
all_elements_of_category = ElementsOfCategory(categories)
watch = Watch(all_elements_of_category)
slabShapeHasBeenModified = Custom[Floor.SlabShapeHasBeenModified](floor=watch)  # Checks if the shape of a floor slab has been modified with the shape editing tools
watch_2 = Watch(slabShapeHasBeenModified)
select_face = DSFaceSelection()  # 1 picked in the model
firstItem = List.FirstItem(select_face)
integer_slider = IntegerSlider(11, range=0..20 step 1)
gridFromFace = Custom[Paneling.GridFromFace](surface=firstItem, U=integer_slider, V=integer_slider)  # Returns UV coordinates, XYZ coordinates and normals for a face with UV subdivision
watch_3 = Watch(gridFromFace.Points)
# note: Run this graph on the Floor_Sample file in the extra folder.
select_model_element = DSModelElementSelection()  # 1 picked in the model
watch_4 = Watch(select_model_element)
slabShapeByPoints = Custom[Floor.SlabShapeByPoints](points=watch_3, floor=watch_4)  # Transform a slab shape based on a list of XYZs. PLEASE NOTE: Will reset any previous edits on the slab shape.
watch_5 = Watch(slabShapeByPoints)
