# Dynamo graph Revit.Elements.Category.dyn (Dynamo 1.0.0.1180)

categories = Categories("Lines")
subcategories = Custom[Category.Subcategories](category=categories)  # Retrieves all the subcategories for a given category
watch = Watch(subcategories)
