# Dynamo graph Revit.Elements.ModelCurve.dyn (Dynamo 1.0.0.1180)

code_block = CodeBlock { 4; }
byWidthLength = Rectangle.ByWidthLength(width=code_block, length=code_block)
curves = PolyCurve.Curves(byWidthLength)
origin = Point.Origin()
ZAxis = Vector.ZAxis()
byOriginNormal = Plane.ByOriginNormal(origin=origin, normal=ZAxis)
byPlane = SketchPlane.ByPlane(byOriginNormal)
views = Views("Level 0")
fromCurve = Custom[RoomSeparator.FromCurve](curve=curves, sketchPlane=byPlane, view=views)  # Creates room separation lines from geometry curves.
watch = Watch(fromCurve)
# note: Run this graph on the ModelCurve_Sample file in the extra folder.
element_types = ElementTypes("ViewPlan")
all_elements_of_type = ElementsOfType(element_types)
type = Custom[View.Type](view=all_elements_of_type)  # Returns the type of a given view
code_block_2 = CodeBlock(type=type) { type == "AreaPlan"; }
filterByBoolMask = List.FilterByBoolMask(list=all_elements_of_type, mask=code_block_2)
firstItem = List.FirstItem(filterByBoolMask.in)
watch_2 = Watch(firstItem)
fromCurve_2 = Custom[AreaSeparator.FromCurve](curve=curves, sketchPlane=byPlane, areaPlanView=watch_2)  # Creates area separation lines from geometry curves.
watch_3 = Watch(fromCurve_2)
fromCurve_3 = Custom[SpaceSeparator.FromCurve](curve=curves, sketchPlane=byPlane, view=views)  # Creates space separation lines from geometry curves.
watch_4 = Watch(fromCurve_3)
