# Dynamo graph Geometry.Abstract.BoundingBox.dyn (Dynamo 2.0.1.5055)

origin = Point.Origin()
code_block = CodeBlock { 5; }
byCenterPointRadius = Sphere.ByCenterPointRadius(centerPoint=origin, radius=code_block)
boundingBox = Geometry.BoundingBox(geometry=byCenterPointRadius)
code_block_2 = CodeBlock { 1; }
byCoordinates = Vector.ByCoordinates(x=code_block_2, y=code_block_2, z=code_block_2)
normalized = Vector.Normalized(vector=byCoordinates)
perimeterCurvesByNormal = Custom[BoundingBox.PerimeterCurvesByNormal](boundingbox=boundingBox, normal=normalized)  # Returns the perimeter curve of a bounding box on a plane determined by a given normal and the centroid of the bounding box
create = List.Create(item0=perimeterCurvesByNormal, item1=byCenterPointRadius)
watch_3d = Watch3D(create)
ZAxis = Vector.ZAxis()
byOriginNormal = Plane.ByOriginNormal(origin=origin, normal=ZAxis)
perimeterCurvesOnPlane = Custom[BoundingBox.PerimeterCurvesOnPlane](boundingbox=boundingBox, plane=byOriginNormal)  # Returns the perimeter curve of a bounding box on a given plane (assuming that the bounding box and plane intersect)
create_2 = List.Create(item0=perimeterCurvesOnPlane, item1=byCenterPointRadius)
watch_3d_2 = Watch3D(create_2)
properties = Custom[BoundingBox.Properties](boundingBox=boundingBox)  # Retrieves the centroid, width depth and height of a given bounding box
watch = Watch(properties.Centroid)
watch_2 = Watch(properties.Width)
watch_3 = Watch(properties.Depth)
watch_4 = Watch(properties.Height)
