# Dynamo graph Geometry.Tesselation.Paneling.Pattern.Hexagonal.dyn (Dynamo 2.0.1.5055)

# note: Run this graph on the Paneling_Sample model in the extra folder.
select_face = DSFaceSelection()  # 1 picked in the model; graph input
firstItem = List.FirstItem(list=select_face)
integer_slider = IntegerSlider(9, range=0..20 step 1)  # graph input
integer_slider_2 = IntegerSlider(12, range=0..20 step 1)  # graph input
gridFromFace = Custom[Paneling.GridFromFace](surface=firstItem, U=integer_slider, V=integer_slider_2)  # Returns UV coordinates, XYZ coordinates and normals for a face with UV subdivision
boolean = BoolSelector(false)  # graph input
integer_slider_3 = IntegerSlider(1, range=0..5 step 1)  # graph input
boolean_2 = BoolSelector(false)  # graph input
integer_slider_4 = IntegerSlider(2, range=0..5 step 1)  # graph input
boolean_3 = BoolSelector(false)  # graph input
hexagonal = Custom[Paneling.Hexagonal](seq=gridFromFace.Points, V=integer_slider_2, reverseOddRows=boolean, shiftPlacementOddRows=integer_slider_3, reverseEvenRows=boolean_2, shiftPlacementEvenRows=integer_slider_4, rotateGridBy90Degrees=boolean_3)
family_types = FamilyTypes(index=5)  # graph input
byPoints = AdaptiveComponent.ByPoints(points=hexagonal.oddRows, familyType=family_types)
family_types_2 = FamilyTypes(index=6)  # graph input
byPoints_2 = AdaptiveComponent.ByPoints(points=hexagonal.evenRows, familyType=family_types_2)
