# Dynamo graph Revit.Application.Document.Query.dyn (Dynamo 2.0.3.8810)

categories = Categories(index=574)  # graph input
categories_2 = Categories(index=386)  # graph input
create = List.Create(item0=categories, item1=categories_2)
containsElementsOfCategory = Custom[Document.ContainsElementsOfCategory](category=create)  # Checks if family instances of specified categories are present in the model.
watch = Watch(containsElementsOfCategory.any)
watch_2 = Watch(containsElementsOfCategory.all)
watch_3 = Watch(containsElementsOfCategory.per_category)
watch_4 = Watch(containsElementsOfCategory.instances)
# note: You can use the Sample STRUCTURAL Project (Basic) that ships with Revit to run this graph.
activeViewFromCurrentDocument = Custom[Document.ActiveViewFromCurrentDocument]()  # Gets the active view of the current document
watch_5 = Watch(activeViewFromCurrentDocument)
toggle_to_refresh = BoolSelector(false)  # graph input
isWorkshared = Custom[Document.IsWorkshared](toggle=toggle_to_refresh)  # Returns true if the current project is workshared
watch_6 = Watch(isWorkshared)
boolean = BoolSelector(true)
builtInCategories = Custom[Document.BuiltInCategories](dynamoSupportedCategoriesOnly=boolean)  # List all the available BuiltInCategories
watch_7 = Watch(builtInCategories.BuiltInCategories)
builtInParameters = Custom[Document.BuiltInParameters]()  # List all the available BuiltInParameters
watch_8 = Watch(builtInParameters.BuiltInParameters)
projectInfo = Custom[Document.ProjectInfo](toggle=toggle_to_refresh)  # Gets the project information.
watch_9 = Watch(projectInfo.Author)
watch_10 = Watch(projectInfo.Number)
watch_11 = Watch(projectInfo.Name)
watch_12 = Watch(projectInfo.Address)
watch_13 = Watch(projectInfo.OrganizationDescription)
watch_14 = Watch(projectInfo.BuildingName)
watch_15 = Watch(projectInfo.IssueDate)
watch_16 = Watch(projectInfo.ClientName)
watch_17 = Watch(projectInfo.Status)
watch_18 = Watch(projectInfo.OrganizationName)
projectPosition = Custom[Document.ProjectPosition](toggle=toggle_to_refresh)  # Gets the project's position data relative to the origin. Output coordinates may diverge from the project base point coordinates once the project base point has been moved in an unclipped state. Use the built-in nodes Location.Latitude & Location.Longitude to retrieve latitude and longitude.
watch_19 = Watch(projectPosition.Angle_degr)
watch_20 = Watch(projectPosition.Elevation)
watch_21 = Watch(projectPosition.EastWest)
watch_22 = Watch(projectPosition.NorthSouth)
designOptions = Custom[Document.DesignOptions]()  # Returns all design options in the model, grouped by design option set
watch_23 = Watch(designOptions.DesignOptions)
watch_24 = Watch(designOptions.DesignOptionSets)
phases = Custom[Document.Phases](toggle=toggle_to_refresh)  # Retrieves all phases in the active document in *chronological* order
watch_25 = Watch(phases)
startingView = Custom[Document.StartingView](toggle=toggle_to_refresh)  # Retrieves the starting view of a Project file. Returns null if no starting view is set.
watch_26 = Watch(startingView)
views = Custom[Document.Views](toggle=toggle_to_refresh)  # Gets all views in the document - except for 3D view templates (as long as this bug is not fixed: https://github.com/DynamoDS/Dynamo/issues/2970)
watch_27 = Watch(views)
watch_28 = Watch(builtInCategories.ElementIDs)
watch_29 = Watch(builtInParameters.ElementIDs)
watch_30 = Watch(builtInParameters.ParameterNames)
worksets = Custom[Document.Worksets](toggle=toggle_to_refresh)  # Returns all Worksets in the current document
watch_31 = Watch(worksets)
default3DView = Custom[Document.Default3DView](toggle=toggle_to_refresh)  # Returns the default 3D view of the current model (if there is such a view)
watch_32 = Watch(default3DView)
projectParameters = Custom[Document.ProjectParameters](toggle=toggle_to_refresh)  # Retrieves all project parameters and the categories they have been assigned to
watch_33 = Watch(projectParameters.paramName)
watch_34 = Watch(projectParameters.categories)
string = StringInput("OST_ProjectInformation")
projectParametersByCategory = Custom[Document.ProjectParametersByCategory](category=string, toggle=toggle_to_refresh)  # Retrieves all project parameters for a given category
watch_35 = Watch(projectParametersByCategory.paramNames)
performanceAdviserRules = Custom[Document.PerformanceAdviserRules]()  # Retrieves all Performance Adviser Rules from the current document
watch_36 = Watch(performanceAdviserRules)
watch_37 = Watch(builtInCategories.Categories)
elementTypes = Custom[Document.ElementTypes]()  # Retrieves a list of all Revit element types
watch_38 = Watch(elementTypes.elementTypes)
watch_39 = Watch(projectParameters.variesAcrossGroups)
watch_40 = Watch(projectParameters.parameterGroup)
watch_41 = Watch(projectParameters.parameterType)
watch_42 = Watch(projectParameters.unitType)
watch_43 = Watch(projectParameters.isVisible)
watch_44 = Watch(projectParameters.parameterElement)
watch_45 = Watch(projectParameters.GUID)
watch_46 = Watch(projectParameters.isInstanceParameter)
watch_47 = Watch(projectParametersByCategory.parameterGroups)
watch_48 = Watch(projectParametersByCategory.variesAcrossGroups)
watch_49 = Watch(projectParametersByCategory.parameterTypes)
watch_50 = Watch(projectParametersByCategory.unitTypes)
watch_51 = Watch(projectParametersByCategory.isVisible)
watch_52 = Watch(projectParametersByCategory.GUIDs)
watch_53 = Watch(projectParametersByCategory.isInstanceParameter)
unitTypes = Custom[Document.UnitTypes](toggle=toggle_to_refresh)  # Retrieves all available unit types of a given document
watch_54 = Watch(unitTypes)
watch_55 = Watch(elementTypes.elementTypeNames)
watch_56 = Watch(projectParametersByCategory.parameterElements)
enums = Custom[Document.Enums]()  # Retrieves all Enums from the Revit API
watch_57 = Watch(enums)
computeVolumes = Custom[Document.ComputeVolumes]()  # Returns whether or not the area and volume settings are set to compute volumes.
watch_58 = Watch(computeVolumes)
