# Dynamo graph Revit.Application.FamilyDocument.dyn (Dynamo 2.0.1.5055)

boolean = BoolSelector(true)  # graph input
currentFamilyType = Custom[FamilyDocument.CurrentFamilyType](toggle=boolean)  # Retrieves the current family type from the active family document. PLEASE NOTE: This node will only work in a family document!
watch = Watch(currentFamilyType)
familyParameters = Custom[FamilyDocument.FamilyParameters](toggle=boolean)  # Retrieves all family parameters from the active family document. PLEASE NOTE: This node will only work in a family document!
watch_2 = Watch(familyParameters)
familyTypes = Custom[FamilyDocument.FamilyTypes](toggle=boolean)  # Retrieves all family types from the active family document. PLEASE NOTE: This node will only work in a family document!
watch_3 = Watch(familyTypes)
