# Dynamo graph Revit.Elements.AngularDimension.dyn (Dynamo 2.0.4.12684)

# note: Run this graph on the CreateStuff sample model.
select_model_element = DSModelElementSelection()  # 1 picked in the model; graph input
select_model_element_2 = DSModelElementSelection()  # 1 picked in the model; graph input
code_block = CodeBlock { 5; }
views = Views(index=2)  # graph input
string = StringInput("DimensionType")
byName = Custom[ElementType.ByName](name=string)  # Retrieves an element type by its name - to be used with the OOTB node "All Elements of Type".
all_elements_of_type = ElementsOfType(element_type=byName)
styleType = DimensionType.StyleType(dimensionType=all_elements_of_type)
code_block_2 = CodeBlock(style=styleType) { style == "Angular"; }
filterByBoolMask = List.FilterByBoolMask(list=all_elements_of_type, mask=code_block_2)
firstItem = List.FirstItem(list=filterByBoolMask.in)
angularByElements = Custom[Dimension.AngularByElements](element1=select_model_element, element2=select_model_element_2, radius=code_block, view=views, dimensionType=firstItem)  # Creates angular dimensions between elements. Only works in project environment. ATTENTION: Do NOT use in automatic mode.
