# Dynamo graph Revit.Elements.Category.dyn (Dynamo 2.0.1.5055)

builtInCategories = Custom[Document.BuiltInCategories]()  # List all the available BuiltInCategories
subcategories = Custom[Category.Subcategories](category=builtInCategories.Categories)  # Retrieves all the subcategories for a given category
watch = Watch(subcategories)
type = Custom[Category.Type](category=builtInCategories.Categories)  # Returns the type of the category
watch_2 = Watch(type)
material = Custom[Category.Material](category=builtInCategories.Categories)  # Retrieves the material assigned to the given category in the object styles
watch_3 = Watch(material)
