# Dynamo graph Revit.Elements.DesignOption.dyn (Dynamo 2.0.3.8810)

# note: Run this script on the DesignOption_Sample model in the extra folder.
designOptions = Custom[Document.DesignOptions]()  # Returns all design options in the model, grouped by design option set
watch = Watch(designOptions.DesignOptions)
designOptionSet = Custom[DesignOption.DesignOptionSet](designOption=watch@L2)  # Returns the design option set of a given design option
watch_2 = Watch(designOptionSet)
element_name_universal = Custom[Element.Name (Universal)](element=watch@L2)  # Gets an element's name. Unlike the OOTB node, this node should work for all Revit elements that have names and will also return the localized names of system parameters, parameter groups, display unit types, parameter types, unit symbol types and unit types.
watch_3 = Watch(element_name_universal)
isPrimary = Custom[DesignOption.IsPrimary](designOption=watch)  # Determines whether a given design option is the primary option in its set
watch_4 = Watch(isPrimary)
