# Dynamo graph Revit.Elements.DirectShape.dyn (Dynamo 1.3.1.1736)

fine = Custom[DetailLevel.Fine]()  # Returns the fine detail level
select_model_elements = DSModelElementsSelection()  # 13 picked in the model
watch = Watch(select_model_elements)
detail_level = DetailLevel("Fine")
geometry = Custom[Element.Geometry+](element=watch, detailLevel=detail_level)  # Returns Dynamo AND native Revit geometry of a given element
watch_2 = Watch(geometry.revitGeometry)
categories = Categories("GenericModel")
name = Custom[Element.Name (Universal)](element=watch)  # "Element.Name+"; Gets an element's name (Dynamo's built-in Name nodes don't work for all element types, e.g. worksets...)
count = List.Count(name)
code_block = CodeBlock(name=name, n=count) { name + "_" + (1..n); }
fromRevitGeometry = Custom[DirectShape.FromRevitGeometry](revitGeometry=watch_2, category=categories, name=code_block)  # Creates a DirectShape from native Revit geometry objects
watch_3 = Watch(fromRevitGeometry)
