# Dynamo graph Revit.Elements.ElevationMarker.dyn (Dynamo 2.0.1.5055)

element_types = ElementTypes(index=97)  # graph input
all_elements_of_type = ElementsOfType(element_type=element_types)
views = Custom[ElevationMarker.Views](elevationMarker=all_elements_of_type)  # Retrieves all views referenced by a given elevation marker
watch = Watch(views)
