# Dynamo graph Revit.Elements.FamilyParameter.dyn (Dynamo 2.0.1.5055)

familyParameters = Custom[FamilyDocument.FamilyParameters]()  # Retrieves all family parameters from the active family document. PLEASE NOTE: This node will only work in a family document!
properties = Custom[FamilyParameter.Properties](familyParameter=familyParameters)  # Retrieves all properties of a given family parameter. PLEASE NOTE: This node will only work in a family document!
watch = Watch(properties.Name)
watch_2 = Watch(properties.CanBeAssignedAFormula)
watch_3 = Watch(properties.IsUserModfiable)
watch_4 = Watch(properties.AssociatedParameters)
watch_5 = Watch(properties.AssociatedElements)
watch_6 = Watch(properties.ParameterNamesInFormula)
watch_7 = Watch(properties.IsInstanceParameter)
watch_8 = Watch(properties.IsSharedParameter)
watch_9 = Watch(properties.IsReportingParameter)
watch_10 = Watch(properties.IsDeterminedByFormula)
watch_11 = Watch(properties.IsReadOnly)
watch_12 = Watch(properties.Formula)
watch_13 = Watch(properties.Type)
watch_14 = Watch(properties.StorageType)
watch_15 = Watch(properties.DisplayUnitType)
watch_16 = Watch(properties.UnitType)
watch_17 = Watch(properties.Group)
watch_18 = Watch(properties.GUID)
