# Dynamo graph Revit.Elements.FilledRegionType.dyn (Dynamo 2.0.3.8810)

element_types = ElementTypes(index=125)  # graph input
all_elements_of_type = ElementsOfType(element_type=element_types)
watch = Watch(all_elements_of_type)
fillPatterns = Custom[FilledRegionType.FillPatterns](filledRegionType=watch)  # Returns the fill pattern(s) of a given filled region type. In Revit versions prior to 2019 the background fill pattern will always return Null.
watch_2 = Watch(fillPatterns.foregroundFillPattern)
watch_3 = Watch(fillPatterns.backgroundFillPattern)
