# Dynamo graph Revit.Elements.Grid.dyn (Dynamo 2.0.1.5055)

# note: You can use the Sample Architecture Project (Basic) that ships with Revit to run this graph.
categories = Categories(index=388)  # graph input
all_elements_of_category = ElementsOfCategory(Category=categories)
watch = Watch(all_elements_of_category)
plane = Custom[Grid.Plane](grid=watch)  # Retrieves the plane of a grid
watch_2 = Watch(plane)
