# Dynamo graph Revit.Elements.ImportInstance.dyn (Dynamo 2.0.1.5055)

# note: Run this graph on the RevitLinkType_Sample model
element_types = ElementTypes(index=157)  # graph input
all_elements_of_type = ElementsOfType(element_type=element_types)
watch = Watch(all_elements_of_type)
isLinked = Custom[ImportInstance.IsLinked](importInstance=watch)  # Determines whether an ImportInstance is linked or not
watch_2 = Watch(isLinked)
