# Dynamo graph Revit.Elements.Level.dyn (Dynamo 2.0.1.5055)

# note: You can use the Sample Architecture Project (Basic) that ships with Revit to run this graph.
categories = Categories(index=119)  # graph input
all_elements_of_category = ElementsOfCategory(Category=categories)
watch = Watch(all_elements_of_category)
plane = Custom[Level.Plane](level=watch)  # Retrieves the plane of a given level
watch_2 = Watch(plane)
firstItem = List.FirstItem(list=watch)
boolean = BoolSelector(false)  # graph input
views = Custom[Level.Views](level=firstItem, toggleToRefresh=boolean)  # Returns all views associated with a given level
watch_3 = Watch(views.firstView)
watch_4 = Watch(views.allViews)
