# Dynamo graph Revit.Elements.MassFloor.dyn (Dynamo 2.0.1.5055)

categories = Categories(index=258)  # graph input
all_elements_of_category = ElementsOfCategory(Category=categories)
# note: You can run this graph on the ModelByFace_Sample file in the extra folder.
watch = Watch(all_elements_of_category)
mass = Custom[MassFloor.Mass](massFloor=watch)  # Gets the mass a given mass floor belongs to
watch_2 = Watch(mass)
