# Dynamo graph Revit.Elements.Material.dyn (Dynamo 2.0.1.5055)

# note: You can use the Sample Architecture Project (Basic) that ships with Revit to run this graph.
categories = Categories(index=326)  # graph input
all_elements_of_category = ElementsOfCategory(Category=categories)
watch = Watch(all_elements_of_category)
firstItem = List.FirstItem(list=watch)
string = StringInput("MyNewMaterial")  # graph input
duplicate = Custom[Material.Duplicate](material=firstItem, name=string)  # Duplicates a material
watch_2 = Watch(duplicate)
assets = Custom[Material.Assets](Material_var=watch)  # Retrieves all assets from a given material
watch_3 = Watch(assets.AppearanceAsset)
watch_4 = Watch(assets.ThermalAsset)
watch_5 = Watch(assets.StructuralAsset)
