# Dynamo graph Revit.Elements.ParameterFilterElement.dyn (Dynamo 2.0.3.8810)

string = StringInput("ParameterFilterElement")
byName = Custom[ElementType.ByName](name=string)  # Retrieves an element type by its name - to be used with the OOTB node "All Elements of Type".
all_elements_of_type = ElementsOfType(element_type=byName)
filterRuleString = Custom[ParameterFilterElement.FilterRuleString](parameterFilterElement=all_elements_of_type)  # Aggregates the filter rules of a given ParameterFilterElement into a human-readable string
watch = Watch(filterRuleString)
