# Dynamo graph Revit.Elements.Part.dyn (Dynamo 2.0.1.5055)

# note: Run this graph on the Parts_Sample file in the extra folder.
categories = Categories(index=484)  # graph input
all_elements_of_category = ElementsOfCategory(Category=categories)
watch = Watch(all_elements_of_category)
sourceElement = Custom[Part.SourceElement](part=watch)  # Retrieves the element a given part was made from
watch_2 = Watch(sourceElement)
