# Dynamo graph Revit.Elements.RevisionCloud.dyn (Dynamo 2.0.1.5055)

categories = Categories(index=541)  # graph input
# note: You can use the Sample Architecture Project (Basic) that ships with Revit to run this graph.
all_elements_of_category = ElementsOfCategory(Category=categories)
create = List.Create(item0=all_elements_of_category)
watch = Watch(create)
element_types = ElementTypes(index=257)  # graph input
all_elements_of_type = ElementsOfType(element_type=element_types)
lastItem = List.LastItem(list=all_elements_of_type)
watch_2 = Watch(lastItem)
views = Views(index=20)  # graph input
fromElements = Custom[RevisionCloud.FromElements](elements=watch, revision=watch_2, view=views)  # Create a revision cloud for a list of Revit elements
watch_3 = Watch(fromElements)
