# Dynamo graph Revit.Elements.RevitLinkType.dyn (Dynamo 1.3.1.1736)

unload_reload = BoolSelector(true)
element_types = ElementTypes("RevitLinkType")
all_elements_of_type = ElementsOfType(element_types)
watch = Watch(all_elements_of_type)
empty = List.Empty()
scopeIf = Custom[ScopeIf+](test=unload_reload, true=watch, false=empty)  # A (hopefully) more robust implementation of ScopeIf. Tests a single boolean and returns a value accordingly.
unload = Custom[RevitLinkType.Unload](revitLinkType=scopeIf)  # Unloads a Revit or IFC link
scopeIf_2 = Custom[ScopeIf+](test=unload_reload, true=empty, false=watch)
reload = Custom[RevitLinkType.Reload](revitLinkType=scopeIf_2)  # Reloads a Revit or IFC link.; unwired: reloadFrom
file_path = Filename("No file selected.")
