# Dynamo graph Revit.Elements.Roof.dyn (Dynamo 2.0.3.8810)

select_model_element = DSModelElementSelection()  # 1 picked in the model; graph input
resetSlabShape = Custom[Roof.ResetSlabShape](roof=select_model_element)  # Resets the slabshape of a roof
watch = Watch(resetSlabShape.roof)
select_face = DSFaceSelection()  # 1 picked in the model; graph input
firstItem = List.FirstItem(list=select_face)
# note: Run this graph on the RoofOrFloor_Sample file in the extra folder.
integer_slider = IntegerSlider(11, range=0..20 step 1)  # graph input
gridFromFace = Custom[Paneling.GridFromFace](surface=firstItem, U=integer_slider, V=integer_slider)  # Returns UV coordinates, XYZ coordinates and normals for a face with UV subdivision
watch_2 = Watch(gridFromFace.Points)
select_model_element_2 = DSModelElementSelection()  # 1 picked in the model; graph input
watch_3 = Watch(select_model_element_2)
slabShapeByPoints = Custom[Roof.SlabShapeByPoints](points=watch_2, roof=watch_3)  # Transform a slab shape based on a list of Points.
create = List.Create(item0=watch, item1=slabShapeByPoints.roof)
slabShapeHasBeenModified = Custom[Roof.SlabShapeHasBeenModified](roof=create)  # Checks if the shape of a roof slab has been modified with the shape editing tools
watch_4 = Watch(slabShapeHasBeenModified)
watch_5 = Watch(slabShapeByPoints.roof)
string = StringInput("OST_Roofs")
all_elements_of_category = Custom[All Elements Of Category+](category=string)  # Gets all placed elements of a given category in the model.
watch_6 = Watch(all_elements_of_category)
kind = Custom[Roof.Kind](roof=watch_6)  # Retrieves the roof kind (Basic, Glazed, Other). PLEASE NOTE: Roofs that were created by face will be identified as 'Other'
watch_7 = Watch(kind)
creationMethod = Custom[Roof.CreationMethod](roof=watch_6)  # Retrieves the creation method of a given roof
watch_8 = Watch(creationMethod)
watch_9 = Watch(resetSlabShape.success)
watch_10 = Watch(slabShapeByPoints.success)
