# Dynamo graph Revit.Elements.RoomTag.dyn (Dynamo 2.0.1.5055)

categories = Categories(index=392)  # graph input
all_elements_of_category = ElementsOfCategory(Category=categories)
watch = Watch(all_elements_of_category)
room = Custom[RoomTag.Room](roomTag=watch)  # Returns the room of a given room tag
watch_2 = Watch(room)
element_types = ElementTypes(index=121)  # graph input
all_elements_of_type = ElementsOfType(element_type=element_types)
category = Custom[Element.Category+](element=all_elements_of_type)  # Returns the category of a given element. Unlike the OOTB node Element.GetCategory, it will work for families, schedules and graphics styles as well.
equals = List.Equals(objectA=category@L1, objectB=categories)
filterByBoolMask = List.FilterByBoolMask(list=all_elements_of_type, mask=equals)
watch_3 = Watch(filterByBoolMask.in)
firstItem = List.FirstItem(list=watch_3)
count = List.Count(list=watch)
ofRepeatedItem = List.OfRepeatedItem(item=firstItem, amount=count)
setType = Custom[RoomTag.SetType](roomTag=watch, roomTagType=ofRepeatedItem)  # Changes the family type of a given room tag to the specified type
watch_4 = Watch(setType.roomTag)
watch_5 = Watch(setType.success)
