# Dynamo graph Revit.Elements.SharedParameterElement.dyn (Dynamo 2.0.3.8810)

element_types = ElementTypes(index=278)  # graph input
all_elements_of_type = ElementsOfType(element_type=element_types)
GUID = Custom[SharedParameterElement.GUID](sharedParameterElement=all_elements_of_type)  # Returns the GUID of a shared parameter
watch = Watch(GUID)
