# Dynamo graph Revit.Elements.StructuralFoundation.dyn (Dynamo 2.0.1.5055)

# note: Run this graph on the StructuralFoundation_Sample file in the extra folder.
categories = Categories(index=172)  # graph input
all_elements_of_category = ElementsOfCategory(Category=categories)
watch = Watch(all_elements_of_category)
kind = Custom[StructuralFoundation.Kind](structuralFoundation=watch)  # Retrieves the kind of a given structural foundation (isolated, wall, slab).
watch_2 = Watch(kind)
