# Dynamo graph Revit.Elements.Topography.dyn (Dynamo 2.0.1.5055)

# note: You can use the Sample Architecture Project (Basic) that ships with Revit to run this graph.
categories = Categories(index=576)  # graph input
all_elements_of_category = ElementsOfCategory(Category=categories)
watch = Watch(all_elements_of_category)
isSubregion = Custom[Topography.IsSubregion](topography=watch)  # Filters out everything that is *not* a topo subregion. Needs Revit 2014 or newer to work.
watch_2 = Watch(isSubregion)
origin = Point.Origin()
XAxis = Vector.XAxis()
byOriginNormal = Plane.ByOriginNormal(origin=origin, normal=XAxis)
firstItem = List.FirstItem(list=watch)
intersectionWithPlane = Custom[Topography.IntersectionWithPlane](plane=byOriginNormal, topo=firstItem)  # Calculates the intersection of a toposurface and a plane
watch_3 = Watch(intersectionWithPlane.points)
watch_4 = Watch(intersectionWithPlane.nurbsCurveByPoints)
byCurve = ModelCurve.ByCurve(curve=watch_4)
watch_5 = Watch(intersectionWithPlane.nurbsCurveByControlPoints)
byCurve_2 = ModelCurve.ByCurve(curve=watch_5)
watch_6 = Watch(intersectionWithPlane.polyCurve)
