# Dynamo graph Revit.Elements.WallType.dyn (Dynamo 2.0.1.5055)

element_types = ElementTypes(index=336)  # graph input
all_elements_of_type = ElementsOfType(element_type=element_types)
# note: You can use the Sample Architecture Project (Basic) that ships with Revit to run this graph.
watch = Watch(all_elements_of_type)
kind = Custom[WallType.Kind](wallType=watch)  # Retrieves the wall kind of a given wall type
watch_2 = Watch(kind)
