# Dynamo graph Revit.Units.dyn (Dynamo 2.0.1.5055)

number_slider = DoubleSlider(35.9, range=0..100 step 0.1)  # graph input
unit_types = UnitTypes(index=2)  # graph input
displayUnitType = Custom[UnitType.DisplayUnitType](unitType=unit_types)  # Retrieves the display unit type for a given unit type.
toInternalUnit = Custom[DisplayUnit.ToInternalUnit](val=number_slider, displayUnitType=displayUnitType.displayUnitType)  # Converts a value from a given display unit to Revit's internal unit
watch = Watch(toInternalUnit)
toDisplayUnit = Custom[InternalUnit.ToDisplayUnit](val=number_slider, displayUnitType=displayUnitType.displayUnitType)  # Converts a value from Revit's internal unit to a given display unit
watch_2 = Watch(toDisplayUnit)
