# Dynamo graph Revit.Views.Schedule.dyn (Dynamo 2.0.3.8810)

string = StringInput("ViewSchedule")
byName = Custom[ElementType.ByName](name=string)  # Retrieves an element type by its name - to be used with the OOTB node "All Elements of Type".
all_elements_of_type = ElementsOfType(element_type=byName)
keyScheduleParameterName = Custom[Schedule.KeyScheduleParameterName](schedule=all_elements_of_type)  # If the schedule is a key schedule, the node returns the name of the key schedule parameter.
watch = Watch(keyScheduleParameterName)
