# Dynamo graph Revit.Views.Sheet.dyn (Dynamo 2.0.1.5055)

categories = Categories(index=371)  # graph input
all_elements_of_category = ElementsOfCategory(Category=categories)
watch = Watch(all_elements_of_category)
schedules = Custom[Sheet.Schedules](sheet=watch)  # Returns all schedules placed on a specified sheet
watch_2 = Watch(schedules)
code_block = CodeBlock { 1..3; }
# note: You can use the Sample Architecture Project (Basic) that ships with Revit to run this graph.
string_from_object = FromObject(obj=code_block)
string = StringInput("""A
B
C""")  # graph input
string_2 = StringInput("\n")  # graph input
split = String.Split(str=string, separater0=string_2)
placeholderByNumberAndName = Custom[Sheet.PlaceholderByNumberAndName](sheetNumber=string_from_object, sheetName=split)  # Creates placeholder sheets
watch_3 = Watch(placeholderByNumberAndName)
scale = Custom[Sheet.Scale](sheet=watch)  # Returns the scale of a given sheet
watch_4 = Watch(scale)
