# Dynamo graph Revit.Views.ViewSheetSet.dyn (Dynamo 2.0.1.5055)

element_types = ElementTypes(index=330)  # graph input
all_elements_of_type = ElementsOfType(element_type=element_types)
watch = Watch(all_elements_of_type)
views = Custom[ViewSheetSet.Views](viewsSheetSet=watch)  # Retrieves all the views/sheets in a given view/sheet set.
watch_2 = Watch(views)
