# Dynamo graph Revit.Elements.GlobalParameter.dyn (Dynamo 2.12.1.8246)
# packages: Clockwork for Dynamo 2.x 2.12.2

select_model_element = DSModelElementSelection()  # 1 picked in the model

# group: INPUTS
instance_parameter_name = StringInput("Kommentare")
global_parameter_name = StringInput("test")
formula_value = StringInput("\"abcd\"")

findByName = GlobalParameter.FindByName(name=global_parameter_name)
wip_element = Python(IN[0]=select_model_element, IN[1]=instance_parameter_name, IN[2]=findByName)  # "WIP: Element.AssociateWithGlobalParameter"; IronPython2; frozen
# ---------- wip_element.python (24 lines) ----------
import clr
import System
clr.AddReference('RevitAPI')
from Autodesk.Revit.DB import *

clr.AddReference("RevitNodes")
import Revit
clr.ImportExtensions(Revit.Elements)

def GetAssociatedGlobalParam(item, param):
	rparams = item.GetParameters(param)
	if len(rparams) > 0: 
		return item.Document.GetElement(rparams[0].GetAssociatedGlobalParameter())
	else: return "*"

items = UnwrapElement(IN[0])
params = IN[1]

if isinstance(IN[0], list): 
	if isinstance(IN[1], list): OUT = [GetAssociatedGlobalParam(x, y) for x, y in zip(items, params)]
	else: OUT = [GetAssociatedGlobalParam(x, params) for x in items]
else: 
	if isinstance(IN[1], list): OUT = [GetAssociatedGlobalParam(items, x) for x in params]
	else: OUT = GetAssociatedGlobalParam(items, params)
# ----------------------------------------

# group: GlobalParameter.SetFormula
setFormula = Custom[GlobalParameter.SetFormula](globalParam=findByName, formula=formula_value)  # package Clockwork for Dynamo 2.x; Sets the formula of a global parameter
watch = Watch(setFormula.globalParam)
watch_2 = Watch(setFormula.success)

passthrough = Custom[Passthrough](passThrough=findByName, waitFor=watch)  # package Clockwork for Dynamo 2.x; Forces a sequential order of execution. The node wired into the output of the Passthrough node will be executed *after* the node wired into the waitFor input (e.g. important for some Revit operations). The value of the passThrough input will be passed on to the node wired into the output port of the Passthrough node.

# group: GlobalParameter.Formula
formula = Custom[GlobalParameter.Formula](globalParam=passthrough)  # package Clockwork for Dynamo 2.x; Returns the formula of a global parameter (if any)
watch_3 = Watch(formula)

select_model_element_2 = DSModelElementSelection()  # 1 picked in the model
list_create = List.Create(item0=select_model_element, item1=select_model_element_2, item2=select_model_element)

# group: Element.AssociatedGlobalParameterByParameter
associatedGlobalParameterByParameter = Custom[Element.AssociatedGlobalParameterByParameter](element=list_create, param=instance_parameter_name)  # package Clockwork for Dynamo 2.x; Returns the global parameter that drives a given parameter of an element
watch_4 = Watch(associatedGlobalParameterByParameter)

# group: GlobalParameter.AffectedElements
affectedElements = Custom[GlobalParameter.AffectedElements](globalParam=watch_4)  # package Clockwork for Dynamo 2.x; Returns the elements that have a parameter driven by the given global parameter
watch_5 = Watch(affectedElements)

select_model_elements = DSModelElementsSelection()  # 47 picked in the model
