# Dynamo graph BinaryToDecimal.dyn (Dynamo 0.6.3.5256)

boolean = BoolSelector(false)
boolean_2 = BoolSelector(true)
list = NewList(index0=boolean, index1=boolean, index2=boolean_2, index3=boolean_2, index4=boolean, index5=boolean_2)
binary_to_decimal = Custom[Binary To Decimal](list=list)  # Converts a list of binary (boolean) values into a decimal value
watch = Watch(binary_to_decimal)
