# Dynamo graph ConvexHull2D.dyn (Dynamo 0.7.1.29946)

select_model_elements = DSModelElementsSelection()  # 19 picked in the model
point = ReferencePoint.Point(select_model_elements, lacing=Longest)
X = Point.X(point)
Y = Point.Y(point)
byCoordinates = UV.ByCoordinates(X, Y, lacing=Longest)
watch = Watch(byCoordinates)
convex_hull_2d = Custom[Convex Hull 2D](UVs=byCoordinates)  # Computes the convex hull of a given set of UV coordinates based on the monotone chain algorithm
watch_2 = Watch(convex_hull_2d)
U = UV.U(convex_hull_2d)
V = UV.V(convex_hull_2d)
byCoordinates_2 = Point.ByCoordinates(U, V, lacing=Longest)
byPoints = Polygon.ByPoints(byCoordinates_2)
watch_3d = Watch3D(byPoints)
explode = Geometry.Explode(byPoints)
byCurve = ModelCurve.ByCurve(explode)
