# Dynamo graph HostedObjectStuff.dyn (Dynamo 0.6.3.5244)

category = Categories(index=206)
category_2 = Categories(index=892)
# note: This example also requires the Select By Category package to be installed.
list = NewList(index0=category, index1=category_2)
get_family_instances_by_category = Custom[Get Family Instances By Category](BuiltInCategories=list)  # Gets all family instances in the model for a given list of categories
get_hosted_object_orientation = Custom[Get Hosted Object Orientation](element_s=get_family_instances_by_category)  # Gets the orientation of a hosted object (e.g. a window or a door - orientation always facing towards exterior)
watch = Watch(get_hosted_object_orientation)
get_host = Custom[Get Host](element_s=get_family_instances_by_category)  # Gets an element's host
watch_2 = Watch(get_host)
