# Dynamo graph ImageToCNC.dyn (Dynamo 0.7.0.28161)

# note: This definition allows the creation of CNC paths (for milling reliefs) in a mass family file out of image data. There are two methods available:
# a) Create parallel lines with varying depths
# b) Create a grid of points with varying depths
# (You could of course adapt method #1 to loft a surface out of the image data...)
# For questions email me at dieckmann@caad.arch.rwth-aachen.de
# note: Layout-related Settings
# note: REQUIRED PACKAGES:
# - Invert And Mirror Normalized Values
# - Unit Conversion
x_count = IntegerSliderInput(50, range=0..50)
y_slider = IntegerSliderInput(50, range=0..50)
formula = Formula("1", lacing=Longest)
x_margin = DoubleSliderInput(0.05, range=0..0.1)
meters_to_feet = Custom[Meters To Feet](meters=x_margin)  # Converts meters into feet
y_margin = DoubleSliderInput(0.05, range=0..0.1)
meters_to_feet_2 = Custom[Meters To Feet](meters=y_margin)
number = DoubleInput(0)
x_overall_width = DoubleSliderInput(1.2, range=0..2)
meters_to_feet_3 = Custom[Meters To Feet](meters=x_overall_width)
formula_2 = Formula("(width-2*margin)/(elements-1)", width=meters_to_feet_3, margin=meters_to_feet, elements=x_count, lacing=Longest)
y_overall_width = DoubleSliderInput(0.8, range=0..2)
meters_to_feet_4 = Custom[Meters To Feet](meters=y_overall_width)
formula_3 = Formula("(width-2*margin)/(elements-1)", width=meters_to_feet_4, margin=meters_to_feet_2, elements=y_slider, lacing=Longest)
# note: Create a point grid based on the settings
xyz_grid = ReferencePtGrid(x_count, y_slider, formula, meters_to_feet, meters_to_feet_2, number, formula_2, formula_3, number, lacing=Longest)
# note: Image-related Settings
path_to_image_file = StringFilename("\\psf\Home\Desktop\dynamo\MyProjects\_ImageToCNC\sample_image.jpg")
read_image_file = ImageFileReader(path_to_image_file, x_count, y_slider)
# note: Replace this with a Color Saturation or Color Hue node for different effects.
color_brightness = ColorBrightness(read_image_file, lacing=Longest)
invert_image_data = BoolSelector(true)
mirror_image_vertically = BoolSelector(false)
mirror_image_horizontally = BoolSelector(true)
# note: Translate normalized values to min and max values from sliders and turn that into a height value
invertAndMirrorNormalizedValues = Custom[InvertAndMirrorNormalizedValues](list=color_brightness, Invert=invert_image_data, Mirror_Vertically=mirror_image_vertically, Mirror_Horizontally=mirror_image_horizontally, X=x_count)  # Inverts and mirrors (horizontally & vertically) a list of normalized values.
minimum_depth = DoubleSliderInput(0.001, range=0..0.01)
meters_to_feet_5 = Custom[Meters To Feet](meters=minimum_depth)
maximum_depth = DoubleSliderInput(0.025, range=0..0.1)
meters_to_feet_6 = Custom[Meters To Feet](meters=maximum_depth)
scale_normalized_value = Custom[Scale Normalized Value](value=invertAndMirrorNormalizedValues, Min=meters_to_feet_5, Max=meters_to_feet_6)  # Scales a normalized value according to a given minimum and maximum
XYZ = Xyz(number, number, scale_normalized_value, lacing=Longest)
subtract_xyz = XyzSubtract(xyz_grid, XYZ, lacing=Longest)
line = LineBound(xyz_grid, subtract_xyz, lacing=Longest)
# note: Create vertical lines
curve_by_points_by_line = CurveByPointsByLine(line, lacing=Longest)
reference_point = ReferencePointByXyz(lacing=Longest)
# note: Change (sp)line direction?
swap_path_direction = BoolSelector(true)
partition_list = Slice(subtract_xyz, x_count)
transpose_lists = Transpose(partition_list)
if_ = Conditional(swap_path_direction, transpose_lists, partition_list)
map = Map(reference_point, if_)
boolean = BoolSelector(false)
# note: Create (more or less) horizontal (sp)lines
curve_by_points = CurveByPoints(map, boolean, lacing=Longest)
list = NewList(index0=number, index1=meters_to_feet_3, index2=meters_to_feet_3, index3=number)
list_2 = NewList(index0=number, index1=number, index2=meters_to_feet_4, index3=meters_to_feet_4)
XYZ_2 = Xyz(list, list_2, number, lacing=Longest)
shift_list_indeces = ShiftList(formula, XYZ_2)
line_2 = LineBound(shift_list_indeces, XYZ_2, lacing=Longest)
# note: Create boundary
curve_by_points_by_line_2 = CurveByPointsByLine(line_2, lacing=Longest)
