# Dynamo graph NumberingStuff_DS.dyn (Dynamo 0.6.3.5256)

select_divided_surface_families = DividedSurfaceBySelection()  # 1 picked in the model
flatten_completely = FlattenList(select_divided_surface_families)
parameter_name = StringInput("Object_Identifier")
# note: This example shows how to number curtain panels that are hosted on a divided surface.
# For questions email me at dieckmann@caad.arch.rwth-aachen.de
prefix = StringInput("DS01_")
suffix = StringInput("")
concat_strings = ConcatStrings(s3=prefix, arg2=suffix)
start_number = DoubleInput(1)
list_length = Length(flatten_completely)
formula = Formula("Start+N-1", Start=start_number, N=list_length, lacing=Longest)
number = DoubleInput(Start..N, start_number, formula, lacing=Longest)
number_to_string = Num2String(number, lacing=Longest)
map = Map(concat_strings, number_to_string)
set_family_instance_parameter = FamilyInstanceParameterSetter(flatten_completely, parameter_name, map, lacing=Longest)
